% Simulink data dictionary dict.sldd

B_bobine = 0.1128
K_L = 0.004
K_amp = 4.7
K_bobine = 0.8493
K_c = 1.422
K_e = 0.9495
K_pos = 806.5
Ki = 0.1408
Kp = 0.001
N_bobine = 66
T_etalonnage = 12
T_simulation = 9.090909e-05
V_consigne = 1.8
a = 0.000197
adc_entrees_resolution = 10
b = 0.0001263
c = 2
dac_commande_resolution = 12
f_courant = 7.8
f_echant = 22
f_position = 7.8
g = 9.81
m_etalon_max = 100
m_etalon_min = 0
m_lame = 150
r_bobine = 0.0203
tau_L = 0.1
v_pos_max = 4.88
v_pos_min = 0.608
x = 69
x_max = 0.0031
x_min = -0.0031
L_bobine = 212
R_bobine = 1.424
R_eq = 1.1
L = 0.27
E = 16950000000
l = 0.0735
gamma = 0.15
h = 0.00159